# Grasshopper definition boxe 2.gh (Grasshopper 1.0.7)

pt = ConstructPoint(XCoordinate=0, YCoordinate=0, ZCoordinate=0)
place_point = GetPoint(pt, AtLeast=1, AtMost=1, Realtime=True)
box_array_cell_between_20_and_40 = GetNumber(Slider(38, range=20..40), AtLeast=1, AtMost=1, Maximum=40, Minimum=20)
max_attractor_scale_between_1_4_and_2_7 = GetNumber(Slider(2.5, range=1.4..2.7), AtLeast=1, AtMost=1, Maximum=2.7, Minimum=1.4)
get_min_attractor_scale_between_0_and_0 = GetNumber(Slider(0.2, range=0..0.29), AtLeast=1, AtMost=1, Maximum=0.29, Minimum=0)  # "Get MIN ATTRACTOR SCALE BETWEEN 0 AND 0.29"
merge = Merge(Data1=box_array_cell_between_20_and_40)
number_slider = Slider(7, range=0..10)
box = CenterBox(Base=PlaneXY(0, 0, 0), X=merge, Y=merge, Z=merge)
number_slider_2 = Slider(7, range=0..10)
arrbox = BoxArray(Geometry=place_point, Cell=box, XCount=number_slider, YCount=number_slider, ZCount=number_slider)  # -> Geometry, Transform
box_2 = CenterBox(Base=arrbox.Geometry, X=number_slider_2, Y=number_slider_2, Z=number_slider_2)
area = Area(Geometry=box_2)  # -> Area, Centroid
vec2pt = Vector2Pt(PointA=area.Centroid, PointB=arrbox.Geometry, Unitize=False)  # -> Vector, Length
item = ListItem(List=area.Centroid, Index=[Slider(1000, range=0..1000), Slider(48, range=0..100)], Wrap=True)
intcrv = Interpolate(Vertices=item, Degree=3, Periodic=False, KnotStyle=1)  # -> Curve, Length, Domain
area_2 = Area(Geometry=box_2)  # -> Area, Centroid
pull = PullPoint(Point=area_2.Centroid, Geometry=intcrv.Curve, ClosestOnly=True)  # -> ClosestPoint, Distance
move = Move(Geometry=box_2, Motion=vec2pt.Vector)  # -> Geometry, Transform
bnd = Bounds(Numbers=pull.Distance)
dom = ConstructDomain(DomainStart=max_attractor_scale_between_1_4_and_2_7, DomainEnd=get_min_attractor_scale_between_0_and_0)
remap = RemapNumbers(Value=pull.Distance, Source=bnd, Target=dom)  # -> Mapped, Clipped
scale = Scale(Geometry=move.Geometry, Center=area_2.Centroid, Factor=remap.Mapped)  # -> Geometry, Transform

# ---- group: RH_OUT:o
brep = Brep(scale.Geometry)

# ----
context_bake = ContextBake(Geometry=brep)
